# Grasshopper definition LampParametric.gh (Grasshopper 1.0.7)

total_width = Slider(85, range=70..90)
edges_top_view = Slider(5, range=3..6)
total_height = Slider(650, range=600..900)
density_wood_slices = Slider(50, range=50..70)
rotation_z_axis = Slider(1, range=0..1.4)
density_wood_slices_2 = GetNumber(density_wood_slices, AtLeast=1, AtMost=1, Maximum=1.797693135e+308, Minimum=-1.797693135e+308)
rotation_z_axis_2 = GetNumber(rotation_z_axis, AtLeast=1, AtMost=1, Maximum=1.797693135e+308, Minimum=-1.797693135e+308)
width_middle = GetNumber(Slider(1.7, range=1.2..2.2), AtLeast=1, AtMost=1, Maximum=1.797693135e+308, Minimum=-1.797693135e+308)
edges_top_view_2 = GetNumber(edges_top_view, AtLeast=1, AtMost=1, Maximum=1.797693135e+308, Minimum=-1.797693135e+308)
total_height_2 = GetNumber(total_height, AtLeast=1, AtMost=1, Maximum=1.797693135e+308, Minimum=-1.797693135e+308)
total_width_2 = GetNumber(total_width, AtLeast=1, AtMost=1, Maximum=1.797693135e+308, Minimum=-1.797693135e+308)
width_top_and_bottom = GetNumber(Slider(0.6, range=0.5..1), AtLeast=1, AtMost=1, Maximum=1.797693135e+308, Minimum=-1.797693135e+308)
xy = XYPlane(Origin=Point(0, 0, 0))
multiplication = Multiplication(A="4", B=edges_top_view_2)
cir = Circle(Plane=xy, Radius=total_width_2)
panel = Panel("""1
1
-1
-1""")
divide = DivideCurve(Curve=cir, Count=multiplication, Kinks=False)  # -> Points, Tangents, Parameters
vec2pt = Vector2Pt(PointA=xy, PointB=divide.Points, Unitize=False)  # -> Vector, Length
repeat = RepeatData(Data=panel, Length=multiplication)
multiplication_2 = Multiplication(A=repeat, B="12")
amp = Amplitude(Vector=vec2pt.Vector, Amplitude=multiplication_2)
move = Move(Geometry=divide.Points, Motion=amp)  # -> Geometry, Transform
nurbs = NurbsCurve(Vertices=move.Geometry, Degree=3, Periodic=invert(False))  # -> Curve, Length, Domain
pi = Pi(Factor=rotation_z_axis_2)
range = Range(Domain=total_height_2, Steps="12")
range_2 = Range(Domain=Domain(0, 1), Steps="12")
range_3 = Range(Domain=pi, Steps="12")
num2pt = NumbersToPoints(Numbers=range, Mask="z")
xy_2 = XYPlane(Origin=num2pt)
graph = GraphMapper(range_2, x0=0, x1=1, y0=0, y1=1, container_name="Gaussian", factor=0.3526571393, mean=0.6243799329, sdev=0.1449275017)
xy_3 = XYPlane(Origin=xy_2)
item = ListItem(List=xy_3, Index=0, Wrap=True)
prot = RotatePlane(Plane=xy_3, Angle=range_3)
bnd = Bounds(Numbers=graph)
dom = ConstructDomain(DomainStart=width_top_and_bottom, DomainEnd=width_middle)
orient = Orient(Geometry=nurbs.Curve, Source=PlaneXY(0, 0, 0), Target=prot)  # -> Geometry, Transform
cir_2 = Circle(Plane=item, Radius=Slider(58, range=0..100))
remap = RemapNumbers(Value=graph, Source=bnd, Target=dom)  # -> Mapped, Clipped
width_wood_slices = Slider(0.7, range=0.7..0.9)
scale = Scale(Geometry=orient.Geometry, Center=prot, Factor=remap.Mapped)  # -> Geometry, Transform
pframes = PerpFrames(Curve=cir_2, Count=density_wood_slices_2, Align=True)  # -> Frames, Parameters
loft = Loft(Curves=scale.Geometry, Options={Adjust=False, Closed=False, LoftEnds=0, LoftSimp=0, LoftType=0, Rebuild=10, Refit=0.01})
box = EvaluateBox(Box=loft, UParameter=0.5, VParameter=0.5, WParameter=0.5)  # -> Plane, Point, Include
pln = Plane(pframes.Frames)
scale_nu = ScaleNU(Geometry=loft, Plane=box.Plane, ScaleX=width_wood_slices, ScaleY=width_wood_slices, ScaleZ=1)  # -> Geometry, Transform
cap = CapHoles(Brep=scale_nu.Geometry)
cap_2 = CapHoles(Brep=loft)
sdiff = SolidDifference(BrepsA=cap_2, BrepsB=cap)
sec = BrepPlane(Brep=sdiff, Plane=pframes.Frames)  # -> flatten(Curves), Points
end = EndPoints(Curve=sec.Curves)  # -> Start, End
alongcrv = SortAlongCurve(Points=end.Start, Curve=cir_2)  # -> Points, Indices
item_2 = ListItem(List=sec.Curves, Index=alongcrv.Indices, Wrap=True)
panel_2 = Panel("""true
false""")
number_slider = Slider(49, range=0..100)
cull = CullPattern(List=item_2, CullPattern=panel_2)
thickness_wood_slices = Slider(1.1, range=0.8..1.1)
settings_custom = SettingsCustom(
    StitchSeams=True,
    SimplePlanes=False,
    Refine=True,
    MinCount=16,
    MaxCount=400,
    AspectRatio=20,
    MaxDistance=0,
    MaxAngle=20,
    MinEdge=number_slider,
    MaxEdge=number_slider)
boundary = BoundarySurfaces(Edges=cull)
amp_2 = Amplitude(Vector=pln, Amplitude=thickness_wood_slices)
mesh_brep = MeshBrep(Brep=boundary, Settings=settings_custom)
expression = Expression(x=amp_2, Expression="-x*2")
move_2 = Move(Geometry=boundary, Motion=amp_2)  # -> Geometry, Transform
mesh_join = MeshJoin(Meshes=mesh_brep)
extr = Extrude(Base=move_2.Geometry, Direction=expression)

# ---- group: RH_OUT:mesh
mesh = Mesh(mesh_join)
