# Grasshopper definition LampParametricTry3.gh (Grasshopper 1.0.7)
# plug-ins: Bifocals, Human

# Corner - points
edges_top_view = Slider(6, range=3..6)
# View
width = Slider(15, range=5..15, expression="x*10")
edges_top_view_2 = GetNumber(edges_top_view, AtLeast=1, AtMost=1, Maximum=1.797693135e+308, Minimum=-1.797693135e+308)
width_2 = GetNumber(width, AtLeast=1, AtMost=1, Maximum=1.797693135e+308, Minimum=-1.797693135e+308)
# eliminate values
xy = XYPlane(Origin=Point(0, 0, 0))
multiplication = Multiplication(A="4", B=edges_top_view_2)
cir = Circle(Plane=xy, Radius=width_2)
panel = Panel("""1
1
-1
-1""")
divide = DivideCurve(Curve=cir, Count=multiplication, Kinks=False)  # -> Points, Tangents, Parameters
vec2pt = Vector2Pt(PointA=xy, PointB=divide.Points, Unitize=False)  # -> Vector, Length
# height
# in every 10cm
repeat = RepeatData(Data=panel, Length=multiplication)
multiplication_2 = Multiplication(A=repeat, B=Slider(8, range=0..20))
amp = Amplitude(Vector=vec2pt.Vector, Amplitude=multiplication_2)
# points in z direction
height = Slider(6, range=3..9, expression="x*100")
move = Move(Geometry=divide.Points, Motion=amp)  # -> Geometry, Transform
# i could give a nice colour at this curve
nurbs = NurbsCurve(Vertices=move.Geometry, Degree=3, Periodic=invert(False))  # -> Curve, Length, Domain
# rotation
number_slider = Slider(12, range=0..100)
height_2 = GetNumber(height, AtLeast=1, AtMost=1, Maximum=1.797693135e+308, Minimum=-1.797693135e+308)
# transformation
number_slider_2 = Slider(1, range=0..1)
pi = Pi(Factor=number_slider_2)
# 0 doesn't work
range = Range(Domain=height_2, Steps=number_slider)
# upper and down part
# upper middle
range_2 = Range(Domain=Domain(0, 1), Steps=number_slider)
range_3 = Range(Domain=pi, Steps=number_slider)
num2pt = NumbersToPoints(Numbers=range, Mask="z")
xy_2 = XYPlane(Origin=num2pt)
graph = GraphMapper(range_2, x0=0, x1=1, y0=0, y1=1, container_name="Gaussian", factor=0.3526571393, mean=0.6243799329, sdev=0.1449275017)
xy_3 = XYPlane(Origin=xy_2)
item = ListItem(List=xy_3, Index=0, Wrap=True)
# Radius can be a fixed number
number_slider_3 = Slider(58, range=0..100)
prot = RotatePlane(Plane=xy_3, Angle=range_3)
bnd = Bounds(Numbers=graph)
dom = ConstructDomain(DomainStart=Slider(0.894, range=0..2), DomainEnd=Slider(1.514, range=0..2))
# density of wood slices
# move it per 10 values
number_slider_4 = Slider(84, range=0..100)
orient = Orient(Geometry=nurbs.Curve, Source=PlaneXY(0, 0, 0), Target=prot)  # -> Geometry, Transform
cir_2 = Circle(Plane=item, Radius=number_slider_3)
remap = RemapNumbers(Value=graph, Source=bnd, Target=dom)  # -> Mapped, Clipped
scale = Scale(Geometry=orient.Geometry, Center=prot, Factor=remap.Mapped)  # -> Geometry, Transform
pframes = PerpFrames(Curve=cir_2, Count=number_slider_4, Align=True)  # -> Frames, Parameters

loft = Loft(Curves=scale.Geometry, Options={Adjust=False, Closed=False, LoftEnds=0, LoftSimp=0, LoftType=0, Rebuild=10, Refit=0.01})

# ----
# width wood
# the more the thinner
number_slider_5 = Slider(0.8, range=0..1)
box = EvaluateBox(Box=loft, UParameter=0.5, VParameter=0.5, WParameter=0.5)  # -> Plane, Point, Include
pln = Plane(pframes.Frames)
scale_nu = ScaleNU(Geometry=loft, Plane=box.Plane, ScaleX=number_slider_5, ScaleY=number_slider_5, ScaleZ=1)  # -> Geometry, Transform
cap = CapHoles(Brep=loft)
cap_2 = CapHoles(Brep=scale_nu.Geometry)

sdiff = SolidDifference(BrepsA=cap, BrepsB=cap_2)

sec = BrepPlane(Brep=sdiff, Plane=pframes.Frames)  # -> flatten(Curves), Points
end = EndPoints(Curve=sec.Curves)  # -> Start, End
alongcrv = SortAlongCurve(Points=end.Start, Curve=cir_2)  # -> Points, Indices
item_2 = ListItem(List=sec.Curves, Index=alongcrv.Indices, Wrap=True)
panel_2 = Panel("""true
false""")
# thickness wood
number_slider_6 = Slider(0.4, range=0..1)
cull = CullPattern(List=item_2, CullPattern=panel_2)
boundary = BoundarySurfaces(Edges=cull)
amp_2 = Amplitude(Vector=pln, Amplitude=number_slider_6)
expression = Expression(x=amp_2, Expression="-x*2")
move_2 = Move(Geometry=boundary, Motion=amp_2)  # -> Geometry, Transform
extr = Extrude(Base=move_2.Geometry, Direction=expression)
previewmat = CustomPreviewMaterials(Geometry=extr, DiffuseColor=RGB(255, 255, 255))
geo = Geometry(extr)
data = Data(extr)
X = UnitX(Factor="500")
move_3 = Move(Geometry=data, Motion=X)  # -> Geometry, Transform

# ---- group: RH_OUT:mesh
mesh = Mesh(move_3.Geometry)

# ----
curve = Curve()
